# Dynamo graph EnergyAnalysisForDynamo_ex1b_CreateEnergyModelAndSetSurfaceParams.dyn (Dynamo 0.7.5.3566)

# note: 1. Select Mass element from Revit/Vasari document
select_model_element = DSModelElementSelection()  # 1 picked in the model
levels = Levels("Level 1")
# note: 2. Create Analysis Zones From Mass and Levels
createByMassLevels = EnergyAnalysisForDynamo.PrepareEnergyModel.CreateByMassLevels(select_model_element, levels)
# note: 3. Decompose Zone and grab one wall surface
code_block = CodeBlock(x=createByMassLevels.out1) { x[1]; }
decomposeZone = EnergyAnalysisForDynamo.PrepareEnergyModel.DecomposeZone(code_block)
code_block_2 = CodeBlock(x=decomposeZone) { x[0]; }
# note: 4. Highlight the modified surface
drawAnalysisSurface = EnergyAnalysisForDynamo.PrepareEnergyModel.DrawAnalysisSurface(code_block_2)
glazing = DoubleSlider(0.6, range=0.2..0.8)
shading_depth = DoubleSlider(1, range=0..1.5)
sill_height = DoubleSlider(1, range=0..2)
conceptual_wall_construction = ConcWallConstTypeDropdown("HighMassConstructionHighInsulation")  # "Conceptual Wall Construction Types Dropdown"
# note: 5. Customize parameters for the surface of interest
setWallSurfaceParameters = EnergyAnalysisForDynamo.PrepareEnergyModel.SetWallSurfaceParameters(code_block_2, glazing, shading_depth, sill_height, conceptual_wall_construction)
