# Dynamo graph EnergyAnalysisForDynamo_ex1c_CreateEnergyModelAndSetZoneParams.dyn (Dynamo 0.7.2.17586)

# note: 1. Select Mass from Revit/Vasari document
select_model_element = DSModelElementSelection()
levels = Levels(index=0)
# note: 2. This node prepares the energy model and outputs zoneIds and surfaceIds.
# Model setting will be inherited from Revits's EnergySetting. You can customize the setting for any zone or surface using SetSurfaceParameters and SetZoneParameters nodes.
createEnergyModelFromMassAndLevels = EnergyAnalysisForDynamo.PrepareEnergyModel.CreateEnergyModelFromMassAndLevels(select_model_element, levels)
surface_index = IntegerSlider(3, range=0..10)
getItemAtIndex = List.GetItemAtIndex(createEnergyModelFromMassAndLevels.out1, surface_index)
# note: 3. Decompose Zone
decomposeZone = EnergyAnalysisForDynamo.PrepareEnergyModel.DecomposeZone(getItemAtIndex)
drawAnalysisSurface = EnergyAnalysisForDynamo.PrepareEnergyModel.DrawAnalysisSurface(decomposeZone)
space_types_dropdown = SpaceTypeDropdown(index=96)
condition_types_dropdown = ConditionType(index=2)
# note: 4. Modify Zone Parameter
setZoneParameters = EnergyAnalysisForDynamo.PrepareEnergyModel.SetZoneParameters(getItemAtIndex, space_types_dropdown, condition_types_dropdown)
